# Grasshopper definition Boolean_operation_GH.gh (Grasshopper 1.0.7)
# plug-ins: sof_gh_sofistik-2022, ShapeDiverForGrasshopper

io = IO(
    SofistikDocumentProperties_VersionMajor="2022",
    SofistikDocumentProperties_VersionMinor="4",
    SofistikDocumentProperties_VersionName="2022")
# import Rhino.Geometry as rg
# if not tollerance:
#     tollerance=0.1
# breps_solid_difference = rg.Brep.CreateBooleanDifference(breps1,breps2,tollerance)
colour_swatch = ColourSwatch(SwatchColor=RGBA(125, 125, 125, 150))

# ---- group: Rhino boolean operations
# Python components
sddp = ShapeDiverDocumentPayload({AbsoluteTolerance=0, AngleTolerance=0, DistanceDisplayPrecision=0, GltfVersion="Gltf2", GrasshopperVersion="1.0.0007", InputGroups="{}", OutputGroups="{}", RelativeTolerance=0, RhinoVersion="7.33.23248.13001", UnitSystem=0, VersionCreated="1.16.1.0", VersionSaved="1.16.1.0"})
ghpython_script = GhPythonScript()  # -> breps_solid_intersection; inputs breps1: list of Brep, breps2: list of Brep
# ---------- ghpython_script: Python ----------
__author__ = "Intelisano Marco"
__version__ = "2024.02.23"

import Rhino.Geometry as rg

if not tollerance:
    tollerance=0.1
#print(tollerance)
breps_solid_intersection = rg.Brep.CreateBooleanIntersection(breps1,breps2,tollerance)
# ---------- end ghpython_script ----------
ghpython_script_2 = GhPythonScript()  # -> breps_solid_difference; inputs breps1: list of Brep, breps2: list of Brep
# ---------- ghpython_script_2: Python ----------
__author__ = "Intelisano Marco"
__version__ = "2024.02.09"

import Rhino.Geometry as rg

if not tollerance:
    tollerance=0.1
#print(tollerance)
breps_solid_difference = rg.Brep.CreateBooleanDifference(breps1,breps2,tollerance)
# ---------- end ghpython_script_2 ----------
ghpython_script_3 = GhPythonScript()  # -> breps_solid_union; inputs breps: list of Brep
# ---------- ghpython_script_3: Python ----------
__author__ = "Intelisano Marco"
__version__ = "2024.01.30"

import Rhino.Geometry as rg

if not tollerance:
    tollerance=0.1
#print(tollerance)
breps_solid_union = rg.Brep.CreateBooleanUnion(breps,tollerance)
# ---------- end ghpython_script_3 ----------
brep = Brep(ghpython_script_3)
brep_2 = Brep(ghpython_script_2)
brep_3 = Brep(ghpython_script)

# ----
# Solid Difference
colour_swatch_2 = ColourSwatch(SwatchColor=RGBA(87, 87, 87, 150))
# import Rhino.Geometry as rg
# if not tollerance:
#     tollerance=0.1
# breps_solid_intersection = rg.Brep.CreateBooleanIntersection(breps1,breps2,tollerance)
colour_swatch_3 = ColourSwatch(SwatchColor=RGBA(125, 125, 125, 150))
# Solid Intersection
colour_swatch_4 = ColourSwatch(SwatchColor=RGBA(87, 87, 87, 150))
brep_4 = Brep(Tree({0;0}: [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], {0;1}: [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]))
brep_5 = Brep([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])
brep_6 = Brep([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])
brep_7 = Brep(Tree({0;0}: [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], {0;1}: [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]))
# Solid Union
colour_swatch_5 = ColourSwatch(SwatchColor=RGBA(87, 87, 87, 150))
brep_8 = Brep([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])
brep_9 = Brep([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])
custom_preview = CustomPreview(Geometry=brep_5, Material=colour_swatch)
custom_preview_2 = CustomPreview(Geometry=brep_6, Material=colour_swatch_2)
tollerance = Slider(0.034, range=0.001..1)
custom_preview_3 = CustomPreview(Geometry=brep_8, Material=colour_swatch_3)
custom_preview_4 = CustomPreview(Geometry=brep_9, Material=colour_swatch_4)
# import Rhino.Geometry as rg
# if not tollerance:
#     tollerance=0.1
# breps_solid_union = rg.Brep.CreateBooleanUnion(breps,tollerance)
tollerance_2 = Slider(0.128, range=0.001..1)
custom_preview_5 = CustomPreview(Geometry=brep_7, Material=colour_swatch_5)
custom_preview_6 = CustomPreview(Geometry=brep_4, Material=ColourSwatch(SwatchColor=RGBA(125, 125, 125, 150)))
merge = Merge(Data1=brep_7, Data2=brep_4)
ghpython_script_4 = GhPythonScript(breps1=brep_9, breps2=brep_8)  # -> breps_solid_intersection; inputs breps1: list of Brep, breps2: list of Brep; same code as ghpython_script
ghpython_script_5 = GhPythonScript(breps1=brep_6, breps2=brep_5, tollerance=tollerance)  # -> breps_solid_difference; inputs breps1: list of Brep, breps2: list of Brep; same code as ghpython_script_2
solid_difference = SolidDifference(BrepsA=brep_6, BrepsB=brep_5)
solid_union = SolidUnion(Breps=merge)
ghpython_script_6 = GhPythonScript(breps=merge, tollerance=tollerance_2)  # -> breps_solid_union; inputs breps: list of Brep; same code as ghpython_script_3
solid_intersection = SolidIntersection(BrepsA=brep_9, BrepsB=brep_8)

# ---- group: GH boolean operations
# GH components
solid_difference_2 = SolidDifference()
solid_difference_3 = SolidDifference()
solid_intersection_2 = SolidIntersection()

# ----
brep_10 = Brep(solid_union)
brep_11 = Brep(solid_difference)
brep_12 = Brep(solid_intersection)
panel = Panel(solid_intersection)
brep_13 = Brep(ghpython_script_6)
panel_2 = Panel(brep_10)
panel_3 = Panel(ghpython_script_4)
brep_14 = Brep(ghpython_script_5)
brep_15 = Brep(ghpython_script_4)
panel_4 = Panel(brep_13)
custom_preview_7 = CustomPreview(Geometry=brep_13, Material=ColourSwatch(SwatchColor=RGBA(102, 118, 128, 150)))
custom_preview_8 = CustomPreview(Geometry=brep_11, Material=ColourSwatch(SwatchColor=RGBA(122, 109, 60, 150)))
custom_preview_9 = CustomPreview(Geometry=brep_14, Material=ColourSwatch(SwatchColor=RGBA(102, 118, 128, 150)))
custom_preview_10 = CustomPreview(Geometry=brep_12, Material=ColourSwatch(SwatchColor=RGBA(122, 109, 60, 150)))
custom_preview_11 = CustomPreview(Geometry=brep_15, Material=ColourSwatch(SwatchColor=RGBA(102, 118, 128, 150)))
