# Grasshopper definition Fix_Mesh.gh (Grasshopper 1.0.7)
# plug-ins: sof_gh_sofistik-2022

io = IO(
    SofistikDocumentProperties_VersionMajor="2022",
    SofistikDocumentProperties_VersionMinor="4",
    SofistikDocumentProperties_VersionName="2022")
mesh = Mesh([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])

# ----
# Mesh2Surface
# Surface
# Mesh
mesh_2 = Mesh(mesh)
demesh = DeconstructMesh(Mesh=mesh_2)  # -> Vertices, Faces, Colours, Normals
deface = DeconstructFace(Face=demesh.Faces)  # -> CornerA, CornerB, CornerC, CornerD
item = ListItem(List=demesh.Vertices, Index=deface.CornerC, Wrap=True)
item_2 = ListItem(List=demesh.Vertices, Index=deface.CornerB, Wrap=True)
item_3 = ListItem(List=demesh.Vertices, Index=deface.CornerD, Wrap=True)
item_4 = ListItem(List=demesh.Vertices, Index=deface.CornerA, Wrap=True)
srf4pt = _4PointSurface(CornerA=item_4, CornerB=item_2, CornerC=item, CornerD=item_3)
srf = Surface(srf4pt)

number_slider = Slider(1, range=0..652)
panel = Panel(mesh)
ghpython_script = GhPythonScript(inputMeshes=mesh)  # -> outMeshes; inputs inputMeshes: list of Mesh
# ---------- ghpython_script: Python ----------
__author__ = "NOINMA"
__version__ = "2023.08.09"

import Rhino.Geometry as rg
import math

def newMesh(iMesh):
    tempMesh = rg.Mesh()
    tempMesh.Faces.AddFaces(iMesh.Faces)
    tempMesh.Vertices.AddVertices(iMesh.Vertices)
    return tempMesh

def checkMesh(elMesh):
#    print elMesh.IsValidWithLog()
    elMesh.Faces.CullDegenerateFaces()
    elMesh.Vertices.CullUnused()
    elMesh.Vertices.CombineIdentical(True, True)
    #elMesh.Weld(math.pi)
    elMesh.Normals.ComputeNormals()
    elMesh.FaceNormals.ComputeFaceNormals()
    elMesh.Compact()
    return elMesh

outMeshes = []
for i in range(0,len(inputMeshes)):
    outMeshes.append(newMesh(checkMesh(inputMeshes[i])))
# ---------- end ghpython_script ----------
list_item = ListItem(List=mesh, Index=number_slider, Wrap=True)
list_item_2 = ListItem(List=ghpython_script, Index=number_slider, Wrap=True)
panel_2 = Panel(ghpython_script)
panel_3 = Panel(list_item)
panel_4 = Panel(list_item_2)
